# Grasshopper definition day light factor.gh (Grasshopper 1.0.8)

unit_z = UnitZ(Factor=Slider(300, range=0..1000))
brep = Brep([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])
extrude = Extrude(Base=brep, Direction=unit_z)

# ---- group: Opaque Faces
panel = Panel("classrooms")

# ----
roomsolid = HBRoomFromSolid(geo=flatten(extrude), name=panel, conditioned=True)  # -> out, rooms; plug-in component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
panel_2 = Panel("https://energyplus-weather.s3.amazonaws.com/europe_wmo_region_6/SVN/SVN_Ljubljana.130140_IWEC/SVN_Ljubljana.130140_IWEC.zip")
downloadepw = LBDownloadWeather(weather_URL=panel_2)  # -> epw_file, stat_file, ddy_file; plug-in component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
wea = HBWeaFromEPW(epw_file=downloadepw.epw_file)  # -> wea; plug-in component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

# ---- group: Apertures
# Geometry Preparation
brep_2 = Brep([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])
glassmod = HBGlassModifier(name="g_material", trans="0.55")  # -> modifier; plug-in component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
aperture = HBAperture(geo=brep_2, rad_mod=glassmod)  # -> report, apertures; plug-in component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

# ----
addsubface = HBAddSubface(hb_obj=flatten(roomsolid.rooms), sub_faces=flatten(aperture.apertures), project_dist=Slider(10, range=0..10))  # -> out, hb_obj, unmatched; plug-in component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

# ---- group: Apertures (continued)
bordershades = HBExtrudedBorderShades(hb_objs=flatten(addsubface.hb_obj), depth="0.3")  # -> report, hb_objs; plug-in component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

# ----
# Model + Grids
panel_3 = Panel("sample_model_grid")
gridrooms = HBSensorGridFromRooms(rooms=bordershades.hb_objs, grid_size="100")  # -> grid, points, mesh; plug-in component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

model = HBModel(rooms=flatten(bordershades.hb_objs), name=panel_3)  # -> out, model; plug-in component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

assigngridsviews = HBAssignGridsAndViews(model=model.model, grids=flatten(gridrooms.grid))  # -> model; plug-in component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
vizwiref = HBVisualizeWireframe(hb_objs=flatten(model.model))  # -> geo; plug-in component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

# ----
# Run Recipe
toggle = BooleanToggle(False)
annualdaylight = HBAnnualDaylight(model=assigngridsviews, wea=wea, enhanced=toggle, run=Toggle(False))  # -> report, results, DA, cDA, UDI, UDI_low, UDI_up; plug-in component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

# ----
# Compute sDA
sda = HBSpatialDaylightAutonomy(DA=annualdaylight.DA)  # -> report, sDA, pass_fail; disabled; plug-in component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
sda_in_each_room = Panel(sda.sDA)  # disabled

# ----
# Visualize Daylight Autonomy
mjoin = MeshJoin(Meshes=gridrooms.mesh)
data = Data(flatten(annualdaylight.DA))
heatmap = LBSpatialHeatmap(values=data, mesh=mjoin, legend_title="%")  # -> mesh, legend, title, colors, legend_par, vis_set; plug-in component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

panel_4 = Panel(data)
